# Grasshopper definition fsm.gh (Grasshopper 1.0.8)
# plug-ins: Portal, MetaHopper

# States
panel = Panel("""start
challenge1
retry
win""")
udp = UdpReceiver(Port="5005", Start=Toggle(True))
# Events(Inputs)
panel_2 = Panel("game_start")
py3 = Python3Script(data=udp)  # -> a
# ---------- py3: Python ----------
data_bytes = bytearray(data)
a = data_bytes.decode("utf-8")
# ---------- end py3 ----------
filter = StreamFilter(Gate=Slider(2, range=0..4), Stream0=panel_2, Stream1="hand_over_bubble", Stream2="fail", Stream3="retry_challenge1")
# Transitions
style = ModelAnnotationStyle()
py3_2 = Python3Script(trigger=Toggle(True), reset=Button(), states=panel, event=filter)  # -> out, a; inputs states: list
# ---------- py3_2: Python ----------
# Inputs: event (str), trigger (bool), reset (bool)

if 'current_state' not in globals() or reset:
    current_state = "start"
else:
    current_state = globals()['current_state']

if trigger and not reset:
    if current_state == "start" and event == "game_start":
        current_state = "challenge1"
    elif current_state == "challenge1" and event == "hand_over_bubble":
        current_state = "win"
    elif current_state == "challenge1" and event == "fail":
        current_state = "retry"
    elif current_state == "retry" and event == "retry_challenge1":
        current_state = "challenge1"

globals()['current_state'] = current_state
a = current_state
# ---------- end py3_2 ----------
panel_3 = Panel(py3_2.a)
mindex = MemberIndex(Set=panel, Member=panel_3)  # -> Index, Count

# ----
# Challenge
number_slider = Slider(10, range=0..10)
equals = Equality(FirstNumber=mindex.Index, SecondNumber=1)  # -> Equality, Inequality
py3_3 = Python3Script(trigger=equals.Equality, duration=number_slider)  # -> out, val
# ---------- py3_3: Python ----------
import time
import Grasshopper

# Persistent variables
if 'start_time' not in globals():
    start_time = None
if 'current_val' not in globals():
    current_val = 0.0
if 'animating' not in globals():
    animating = False
if 'was_triggered' not in globals():
    was_triggered = False

# Rising edge detection
rising_edge = trigger and not was_triggered
was_triggered = trigger

# Reset time when triggered again
if rising_edge:
    start_time = time.time()
    animating = True

# Animation logic
if animating and start_time is not None:
    elapsed = time.time() - start_time
    t = min(elapsed / duration, 1.0)

    # Smoothstep easing
    current_val = t * t * (3 - 2 * t)

    # Stop animation when done
    if t >= 1.0:
        animating = False
    else:
        ghenv.Component.ExpireSolution(True)  # Keep updating

# Output
val = current_val
# ---------- end py3_3 ----------
onoff = EnableDisableObject(Enabled=equals.Equality, AllObjects_Object=preview)
crv = Curve(<curve referenced from the Rhino model>)
eval = EvaluateCurve(Curve=reparameterize(crv), Parameter=py3_3.val)  # -> Point, Tangent, Angle
cir = Circle(Plane=eval.Point, Radius=Slider(6, range=0..10))
boundary = BoundarySurfaces(Edges=cir)
preview = CustomPreview(Geometry=boundary, Material=ColourSwatch(SwatchColor=RGB(237, 50, 50)))  # disabled

# ----
# Win
number_slider_2 = Slider(5, range=0..10)
equals_2 = Equality(FirstNumber=mindex.Index, SecondNumber=3)  # -> Equality, Inequality
crv_2 = Curve(<curve referenced from the Rhino model>)
area = Area(Geometry=crv_2)  # -> Area, Centroid
onoff_2 = EnableDisableObject(Enabled=equals_2.Equality, AllObjects_Object=tag)
tag = TextTag3D(Location=area.Centroid, Text="Win", Size=number_slider_2, Colour=ColourSwatch(SwatchColor=RGB(0, 0, 0)), Justification=5)

# ----
# Start
equals_3 = Equality(FirstNumber=mindex.Index, SecondNumber=0)  # -> Equality, Inequality
crv_3 = Curve(<curve referenced from the Rhino model>)
# Actions
onoff_3 = EnableDisableObject(Enabled=equals_3.Equality, AllObjects_Object=tag_2)
area_2 = Area(Geometry=crv_3)  # -> Area, Centroid
tag_2 = TextTag3D(
    Location=area_2.Centroid,
    Text="Get Ready",
    Size=Slider(5, range=0..10),
    Colour=ColourSwatch(SwatchColor=RGB(0, 0, 0)),
    Justification=5)  # disabled

# ----
# Retry
number_slider_3 = Slider(5, range=0..10)
equals_4 = Equality(FirstNumber=mindex.Index, SecondNumber=2)  # -> Equality, Inequality
crv_4 = Curve(<curve referenced from the Rhino model>)
onoff_4 = EnableDisableObject(Enabled=equals_4.Equality, AllObjects_Object=tag_3)
area_3 = Area(Geometry=crv_4)  # -> Area, Centroid
tag_3 = TextTag3D(
    Location=area_3.Centroid,
    Text="Retry?",
    Size=number_slider_3,
    Colour=ColourSwatch(SwatchColor=RGB(0, 0, 0)),
    Justification=5)  # disabled
